# Grasshopper definition gh_script.gh (Grasshopper 1.0.7)

number_slider = Slider(0, range=0..100)  # disabled
brep = Brep([<brep referenced from the Rhino model> x5])
simplify_brep = GhPythonScript(Bs=brep, min_area="0.01")  # -> out, Polylines, Planes; inputs Bs: list of Brep
# ---------- simplify_brep: Python ----------
__author__ = "ziqwang"

import rhinoscriptsyntax as rs
import ghpythonlib.components as gh

Polylines = []
Planes = []

for brep in Bs:
    F = gh.DeconstructBrep(brep)[0]
    
    result_polyline = []
    result_plane = []
    
    for f in F:
        area = gh.Area(f)[0]
        [planar, plane] = gh.IsPlanar(f, False)
        if area > min_area and planar == True:
            vertices = gh.DeconstructBrep(f)[2]
            polyline = gh.ConvexHull(vertices, plane)[1]
            
            result_polyline.append(polyline)
            result_plane.append(plane)
            #Polylines = polyline
            #Planes = plane
    
    Polylines.append(result_polyline)
    Planes.append(result_plane)
# ---------- end simplify_brep ----------
volume = Volume(Geometry=brep)  # -> Volume, Centroid
item = ListItem(List=brep, Index=number_slider, Wrap=True)  # disabled
number_slider_2 = Slider(26, range=0..100)  # disabled
debrep = DeconstructBrep(Brep=item)  # -> Faces, Edges, Vertices; disabled
identify_contact = GhPythonScript(Polylines=simplify_brep.Polylines, Planes=simplify_brep.Planes, Cts=volume.Centroid, max_dist="3")  # -> graph, debug; inputs Polylines: list, Planes: list, Cts: list of Point3d
# ---------- identify_contact: Python ----------
__author__ = "ziqwang"

import rhinoscriptsyntax as rs
import ghpythonlib.components as gh
import math

angle_eps = 1.0 / 180 * math.pi
dist_eps = 0.01

#check func

def check_blocks_in_contact(blockI, blockJ):    
    
    for faceI in range(0, len(Planes[blockI])):
        for faceJ in range(0, len(Planes[blockJ])):
            
            planeI = Planes[blockI][faceI]
            planeJ = Planes[blockJ][faceJ]
                    
            normalI = gh.DeconstructPlane(planeI)[3]
            normalJ = gh.DeconstructPlane(planeJ)[3]
            
            ptI = gh.DeconstructPlane(planeI)[0]
            ptJ = gh.DeconstructPlane(planeJ)[0]
            
            ptIJ = gh.Subtraction(ptJ, ptI)
            dist = gh.DotProduct(ptIJ, normalI, False)
            #print(dist)
            angle = gh.Angle(normalI, normalJ)[0]
            if abs(angle - math.pi) < angle_eps and dist > 0 and dist < dist_eps:
                data = [blockI, blockJ, normalI[0], normalI[1], normalI[2]]
                return [True, data]
    
    return [False, []]


#main

debug = "["
graph = []
N = len(Planes)
for blockI in range(0, N):
    for blockJ in range(blockI + 1, N):
        ctI = Cts[blockI]
        ctJ = Cts[blockJ]
        dist = gh.VectorLength(ctI - ctJ)
        if dist < max_dist:            
            [in_contact, result_data] = check_blocks_in_contact(blockI, blockJ)
            if in_contact  == True:
                print(result_data)
                debug+= "[{}, {}, {}, {}, {}],\n".format(result_data[0], result_data[1], result_data[2], result_data[3], result_data[4])
                graph.append(result_data)
debug += "]"
# ---------- end identify_contact ----------
panel = Panel(identify_contact.debug)
item_2 = ListItem(List=debrep.Faces, Index=number_slider_2, Wrap=True)  # disabled
debrep_2 = DeconstructBrep(Brep=item_2)  # -> Faces, Edges, Vertices; disabled
planar = IsPlanar(Surface=item_2, Interior=True)  # -> Planar, Plane; disabled
panel_2 = Panel("""1
2
3
4""")
hull = ConvexHull(Points=debrep_2.Vertices, Plane=planar.Plane)  # -> Hull, HullZ, Indices; disabled
mult_directions = GhPythonScript(graph=identify_contact.graph, candidate=panel_2, boundary="0")  # -> out, vec; inputs graph: list, candidate: list of Int32, boundary: list of Int32
# ---------- mult_directions: Python ----------
__author__ = "ziqwang"

import rhinoscriptsyntax as rs
import ghpythonlib.components as gh

from compas.rpc import Proxy

gkr_solver = Proxy('gkr_mult_drt_robot.solver.solver')

result = gkr_solver.compute_simultaneous_translational_disassembling_directions(graph, candidate, boundary)

vec = []
if result[0] == True:
    velocities = result[1]
    for id in range(0, len(candidate)):
        velocity = gh.ConstructPoint(velocities[id][0], velocities[id][1], velocities[id][2])
        vec.append(velocity)
else:
    vec = [gh.VectorXYZ(0, 0, 0) for x in range(0, len(candidate))]
# ---------- end mult_directions ----------
unit = UnitVector(Vector=mult_directions.vec)
item_3 = ListItem(List=brep, Index=panel_2, Wrap=True)
multiplication = Multiplication(A=unit, B=Slider(0.31, range=0..1))
move = Move(Geometry=item_3, Motion=multiplication)  # -> Geometry, Transform
item_4 = ListItem(List=brep, Index="0", Wrap=True)
